% Requirement links of TestingScript.m (R2025b)

% line 5 verifies Requirements.slreqx#42
        function verifyWingUnfoldedSpan(testCase)

% line 10 verifies Requirements.slreqx#43
        function verifyWingFoldedSpan(testCase)

% line 14 verifies Requirements.slreqx#45
        function verifyAircraftHeight(testCase)

% line 18 verifies Requirements.slreqx#44
        function verifyAircraftLength(testCase)

% line 22 verifies Requirements.slreqx#8
        function verifyNumEngines(testCase)

% line 26 verifies Requirements.slreqx#36
        function verifyDesignLoadFactor(testCase)

% line 30 verifies Requirements.slreqx#25
        function verifyA2ACombatRadius(testCase)

% line 36 verifies Requirements.slreqx#31
        function verifyA2GCombatRadius(testCase)

% line 42 verifies Requirements.slreqx#18
        function verifyCMEA(testCase)

% line 50 verifies Requirements.slreqx#19
        function verifyLandingSpeed(testCase)

% line 57 verifies Requirements.slreqx#47
        function verifyMTOW(testCase)

% line 65 verifies Requirements.slreqx#41
        function verifyLandingSEROC(testCase)

% line 82 verifies Requirements.slreqx#40
        function verifyCMEA_SEROC(testCase)

% line 98 verifies Requirements.slreqx#37
        function verifyExternalStores(testCase)

% line 102 verifies Requirements.slreqx#33
        function verifySeaLevelDash(testCase)

% line 109 verifies Requirements.slreqx#29
        function verifyCombatDash(testCase)